# Grasshopper definition clipping_volume.gh (Grasshopper 1.0.5)

bounding_box = BoundingBox(Content=[<brep referenced from the Rhino model> x2], Plane=PlaneXY(0, 0, 0), UnionBox=True)  # -> Box, Box_2
guid = Guid([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])

# ---- group: needs patch for Plane param to convert from Guid (ClippingPlaneObject) to Plane
plane = Plane(guid)

# ----
cluster = Cluster(bbin=bounding_box.Box, selectcps=guid, plane=plane)
generate_clipping_volume = CSharpScript(SceneBoundingBox=bounding_box.Box, ClippingPlanes=plane)  # -> out, ClippingVolume; inputs SceneBoundingBox: Brep, ClippingPlanes: list of Plane
# ---------- generate_clipping_volume: C# ----------
    var absol = RhinoDocument.ModelAbsoluteTolerance;
    var anglerad = RhinoDocument.ModelAngleToleranceRadians;
    var sbb = SceneBoundingBox.GetBoundingBox(true);
    sbb.Inflate(0.1);
    var brsbb = sbb.ToBrep();
    List<Brep> parts = new List<Brep>(8);

    foreach(var cp in ClippingPlanes) {
      Curve[] crvs;
      Point3d[] pts;
      Rhino.Geometry.Intersect.Intersection.BrepPlane(brsbb, cp, absol, out crvs, out pts);
      if(crvs != null) {
        Rhino.Collections.CurveList crvl = new CurveList(crvs);
        var b = Brep.CreatePlanarBreps(crvl, absol);
        if(b.Length == 1) {

          var theb = b[0];

          var prts = brsbb.Split(theb, absol);
          foreach(var prt in prts) {
            var clprt = prt.CapPlanarHoles(absol);
            if(clprt != null) {
              var pln = new PolyCurve();
              foreach(var crv in crvs) {
                pln.AppendSegment(crv);
              }
              var pl = pln.ToPolyline(absol, anglerad, 0, double.MaxValue).ToPolyline();
              var cent = pl.CenterPoint();
              var norm = theb.Faces[0].NormalAt(0, 0);
              var volprop = VolumeMassProperties.Compute(clprt);
              var pp = new Vector3d(volprop.Centroid - cent);
              //pp.Unitize();
              //norm.Unitize();
              if((pp * norm) < 0) parts.Add(clprt);
            }
          }
        }
      }
    }
    var volbrep = Brep.CreateBooleanUnion(parts, absol);
    Mesh final = new Mesh();
    foreach(var vb in volbrep) {
      var volmeshes = Mesh.CreateFromBrep(vb, MeshingParameters.FastRenderMesh);

      foreach(var vm in volmeshes) {
        final.Append(vm);
      }
    }
    ClippingVolume = final;
# ---------- end generate_clipping_volume ----------
mesh = Mesh(generate_clipping_volume.ClippingVolume)

# ==== cluster Cluster
bbin = ClusterInput()

# ---- group: get bounding box for scene, slightly inflated
inflate_bb = GhPythonScript(bbin=bbin, amount=Slider(0.1, range=0..1))  # -> out, bbout; inputs bbin: Box
# ---------- inflate_bb: Python ----------
import Rhino.Geometry as rg
"""Provides a scripting component.
    Inputs:
        x: The x script variable
        y: The y script variable
    Output:
        a: The a output variable"""

__author__ = "Nathan"
__version__ = "2018.04.25"

import rhinoscriptsyntax as rs

if bbin:
    bb = bbin.BoundingBox
    bb.Inflate(amount)
    bbout = bb
# ---------- end inflate_bb ----------

# ----
selectcps = ClusterInput()

# ---- group: get all clipping planes in document
getclippingplanes = GhPythonScript(selectcps=selectcps)  # -> out, cps; inputs selectcps: list of Guid
# ---------- getclippingplanes: Python ----------
import Rhino as r
"""Provides a scripting component.
    Output:
        cps: List with found clipping planes"""
        
__author__ = "Nathan"
__version__ = "2018.04.25"
        
import rhinoscriptsyntax as rs
ad = r.RhinoDoc.ActiveDoc

cpobs = [ad.Objects.FindId(sc).ClippingPlaneGeometry for sc in selectcps]
#tmp = [go.ClippingPlaneGeometry for go in ad.Objects if isinstance(go, r.DocObjects.ClippingPlaneObject)]
cps = cpobs
#print(tmp)
#print(cpobs)
# ---------- end getclippingplanes ----------

# ----
plane = ClusterInput()

# ---- group: Generate split surfaces from clipping planes and bounding box
brep_plane = BrepPlane(Brep=inflate_bb.bbout, Plane=flatten(plane), UseTasks=False)  # -> Curves, Points
prune_tree = PruneTree(Tree=brep_plane.Curves, Minimum=1, Maximum=0)
boundary_surfaces = BoundarySurfaces(Edges=prune_tree, UseTasks=False)  # -> simplify(Surfaces)

# ---- group: Split 'n Cap
split_brep = SplitBrep(Brep=inflate_bb.bbout, Cutter=boundary_surfaces)
cap_holes = CapHoles(Brep=split_brep)

# ---- group: test if brep is behind clipping plane
evaluate_surface = EvaluateSurface(Surface=boundary_surfaces, Point=Point(0, 0, 0))  # -> Point, Normal, UDirection, VDirection, Frame
polygon_center = PolygonCenter(Polyline=boundary_surfaces)  # -> CenterV, CenterE, CenterA
volume = Volume(Geometry=cap_holes)  # -> Volume, Centroid
subtraction = Subtraction(A=volume.Centroid, B=polygon_center.CenterA)
dot_product = DotProduct(VectorA=subtraction, VectorB=evaluate_surface.Normal, Unitize=False)
smaller_than = SmallerThan(FirstNumber=dot_product, SecondNumber=0)  # -> SmallerThan, OrEqualTo

# ---- group: Select BReps that contain check-point
dispatch = Dispatch(List=cap_holes, DispatchPattern=smaller_than.SmallerThan)  # -> flatten(ListA), flatten(ListB)

# ---- group: Generate final clipping volume mesh
solid_union = SolidUnion(Breps=dispatch.ListA)
settings_speed = SettingsSpeed()
mesh_brep = MeshBrep(Brep=solid_union, Settings=settings_speed)

# ----
panel = Panel(smaller_than.SmallerThan)
