# Grasshopper definition rhino_full_shader.gh (Grasshopper 1.0.7)
# plug-ins: Shader Nodes

light_path = Light_path()  # -> IsCameraRay, IsShadowRay, IsDiffuseRay, IsGlossyRay, IsSingularRay, IsReflectionRay, IsTransmissionRay, IsVolumeScatterRay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
texcoord = Texcoord()  # -> Generated, Normal, UV, Object, Camera, Window, Reflection, WcsBox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

# ---- group: INPUT: REFRACTION / TRANSPARENCY
m_shader_hastransparencytextureasfloat = Slider(0, range=0..1)
m_shader_transparencytexture_amount = Slider(0, range=0..1)
m_shader_ior = Slider(1.45, range=1..5)
m_shader_transparency = Slider(1, range=0..1)
m_shader_refractionroughnesspow2 = Slider(0, range=0..1)

# ----
m_shader_bumptexture_amount = Slider(1, range=0..1)
m_shader_basecolor = ColourPicker(PickedColour=RGB(208, 72, 0))
m_shader_environmenttexture_amount = Slider(0, range=0..1)

m_shader_reflectioncolorgamma = ColourPicker(PickedColour=RGB(255, 255, 255))
m_shader_transparencycolorgamma = ColourPicker(PickedColour=RGB(45, 212, 255))
m_shader_emissioncolorgamma = ColourPicker(PickedColour=RGB(0, 0, 0))

# ---- group: CONSTANTS
black = ColourPicker(PickedColour=RGB(0, 0, 0))
white = ColourPicker(PickedColour=RGB(255, 255, 255))

# ---- group: INPUT: DIFFUSE
m_shader_diffusetexture_amount = Slider(0, range=0..1)
m_shader_diffusetexture_usealphaasfloat = Slider(0, range=0..1)
m_shader_diffusetexture_invertrepeatasfl = Slider(1, range=0..1)  # "m_shader.DiffuseTexture.InvertRepeatAsFloat"
m_shader_shadelessasfloat = Slider(0, range=0..1)

# ---- group: INPUT: REFLECTION
m_shader_reflectivity = Slider(0, range=0..1)
m_shader_reflectionroughnesspow2 = Slider(0, range=0..1)
m_shader_fresnelior = Slider(1.45, range=1..5)
m_shader_fresnelreflectionsasfloat = Slider(0, range=0..1)

# ---- group: DIFFUSE COLOR
invert_transparency = Invert_transparency(Value1=1, Value2=m_shader_transparency, UseClamp=False)
diffuse_texture = Diffuse_texture(
    Vector=texcoord.UV,
    ImTexColorSpace="None",
    ImTexInterpolation="Smart",
    ImTexProjection="Flat",
    ImTexTextureExtension="Repeat",
    Image="U:\Nathan\BugFiles\RH-42075_CyclesAlphaTransIssue_embedded_files\tree_alpha_1.png")  # -> Color, Alpha

# ---- group: CUSTOM REFLECTION
m_shader_usecustomreflectionenvironmenta = Slider(1, range=0..1)  # "m_shader.UseCustomReflectionEnvironmentAsFloat"
m_shader_reflectioncoloras4float = ColourPicker(PickedColour=RGB(23, 220, 128))
refl_env_texture = Environment(
    Vector=texcoord.Generated,
    ColorSpace="None",
    Environment="C:\Users\Nathan\Documents\RhinoStudio.png",
    Interpolation="Linear",
    Projection="Equirectangular")  # -> Color, Alpha
m_shader_hasreflenvtextureasfloat = Slider(1, range=0..1)
refl_color_or_texture = Mix(
    Color1=m_shader_reflectioncoloras4float,
    Color2=refl_env_texture.Color,
    Fac=m_shader_hasreflenvtextureasfloat,
    Blend="Blend")

# ---- group: DIFFUSE COLOR / diffuse alpha
one_if_usealphatransp_turned_off = LessThan(Value1=m_shader_diffusetexture_usealphaasfloat, Value2=1, UseClamp=False)
weight_diffuse_amount_by_transparency_in = Weight_diffuse_amount_by_transparency_inv(Value1=m_shader_diffusetexture_amount, Value2=invert_transparency, UseClamp=False)
max_of_texalpha_or_usealpha = Maximum(Value1=diffuse_texture.Alpha, Value2=one_if_usealphatransp_turned_off, UseClamp=False)
diff_tex_amount_multiplied_with_inv_tran = Multiply(Value1=weight_diffuse_amount_by_transparency_in, Value2=invert_transparency, UseClamp=False)  # "diff_tex_amount_multiplied_with_inv_transparency"
diff_tex_weighted_alpha_for_basecol_mix = Multiply(Value1=diff_tex_amount_multiplied_with_inv_tran, Value2=diffuse_texture.Alpha, UseClamp=False)
use_alpha_weighted_with_modded_amount = Multiply(Value1=m_shader_diffusetexture_usealphaasfloat, Value2=weight_diffuse_amount_by_transparency_in, UseClamp=False)
invert_alpha = Invert_alpha(Value1=1, Value2=max_of_texalpha_or_usealpha, UseClamp=False)
diffuse_base_color_through_alpha = Mix(Color1=m_shader_basecolor, Color2=diffuse_texture.Color, Fac=diff_tex_weighted_alpha_for_basecol_mix, Blend="Blend")
diffuse_base_color_through_alpha_2 = Mix(
    Color1=diffuse_base_color_through_alpha,
    Color2=diffuse_texture.Color,
    Fac=use_alpha_weighted_with_modded_amount,
    Blend="Blend")

# ---- group: BACKGROUND
m_shader_color1asfloat4 = ColourPicker(PickedColour=RGB(36, 118, 255))
m_shader_hasbgenvtextureasfloat = Slider(1, range=0..1)
bg_env_texture = Environment(
    Vector=texcoord.Generated,
    ColorSpace="None",
    Environment="C:\Users\Nathan\Documents\Dublin Studio.png",
    Interpolation="Smart",
    Projection="Equirectangular")  # -> Color, Alpha
m_shader_usegradientasfloat = Slider(0, range=0..1)
bg_color_or_texture = Mix(Color1=m_shader_color1asfloat4, Color2=bg_env_texture.Color, Fac=m_shader_hasbgenvtextureasfloat, Blend="Blend")

# ---- group: bump
bump_texture = Bump_texture(
    Vector=texcoord.UV,
    ImTexColorSpace="None",
    ImTexInterpolation="Smart",
    ImTexProjection="Flat",
    ImTexTextureExtension="Repeat")  # -> Color, Alpha
bump_texture_to_bw = Bump_texture_to_bw(Color=bump_texture.Color)
bump_amount = Bump_amount(Value1=Slider(4.66, range=0..10), Value2=m_shader_bumptexture_amount, UseClamp=False)
bump = Bump(Height=bump_texture_to_bw, Normal=Point(0, 0, 0), Strength=bump_amount, Distance=0.1)

# ---- group: BG COLOR
gradienttexture = Gradient(Vector=texcoord.Window, Gradient="Linear")  # -> Color, Fac
gradient_colorramp = ColorRamp(Fac=gradienttexture.Fac, StopColours=[RGB(240, 148, 20), RGB(128, 0, 0)], StopPositions=[0, 1], Interpolation="Linear")  # -> Color, Alpha

# ---- group: TRANSPARENCY FACTOR FOR CUTOUT
transparency_texture = Transparency_texture(
    Vector=texcoord.UV,
    ImTexColorSpace="None",
    ImTexInterpolation="Smart",
    ImTexProjection="Flat",
    ImTexTextureExtension="Repeat")  # -> Color, Alpha
transpluminance = Transpluminance(Color=transparency_texture.Color)
invert_luminence = Invert_luminence(Value1=1, Value2=transpluminance, UseClamp=False)
transparency_texture_amount = Transparency_texture_amount(Value1=invert_luminence, Value2=m_shader_transparencytexture_amount, UseClamp=False)
toggle_diffuse_texture_alpha_usage = Toggle_diffuse_texture_alpha_usage(Value1=invert_alpha, Value2=m_shader_diffusetexture_usealphaasfloat, UseClamp=False)
toggle_transparency_texture = Toggle_transparency_texture(Value1=m_shader_hastransparencytextureasfloat, Value2=transparency_texture_amount, UseClamp=False)
add_diffuse_texture_alpha = Add_diffuse_texture_alpha(Value1=toggle_diffuse_texture_alpha_usage, Value2=toggle_transparency_texture, UseClamp=False)

# ---- group: ENVMAP COMPONENT / envmap vector fix
separate_envmap_texco = Separate_xyz(Vector=texcoord.EnvEmap)  # -> X, Y, Z
flip_sign_envmap_texco_y = Multiply(Value1=separate_envmap_texco.Y, Value2=-1, UseClamp=False)
recombine_envmap_texco = Combine_xyz(X=separate_envmap_texco.X, Y=flip_sign_envmap_texco_y, Z=separate_envmap_texco.Z)

# ---- group: REFLECTION FACTOR
fresnel_based_on_constant = Fresnel_based_on_constant(IOR=m_shader_fresnelior, Normal=bump)
fresnel_reflection_if_reflection_used = Fresnel_reflection_if_reflection_used(Value1=m_shader_reflectivity, Value2=m_shader_fresnelreflectionsasfloat, UseClamp=False)
simple_reflection = Simple_reflection(R=m_shader_reflectivity, G=0, B=0)
fresnel_reflection = Fresnel_reflection(R=fresnel_based_on_constant, G=0, B=0)
select_reflection_or_fresnel_reflection = Select_reflection_or_fresnel_reflection(Color1=simple_reflection, Color2=fresnel_reflection, Fac=fresnel_reflection_if_reflection_used, Blend="Blend")
reflection_factor = Reflection_factor(Image=select_reflection_or_fresnel_reflection)  # -> R, G, B

# ---- group: determine shadow ray
invert_roughness = Invert_roughness(Value1=1, Value2=m_shader_refractionroughnesspow2, UseClamp=False)
multiply_transparency = Multiply_transparency(Value1=invert_roughness, Value2=m_shader_transparency, UseClamp=False)
multiply_with_shadowray = Multiply_with_shadowray(Value1=multiply_transparency, Value2=light_path.IsShadowRay, UseClamp=False)
weight_for_shadowray_coloured_shadow = Weight_for_shadowray_coloured_shadow(Value1=multiply_with_shadowray, Value2=1, UseClamp=False)

# ----
use_reflect_refract_when_glossy_and_refl = Multiply(Value1=light_path.IsGlossyRay, Value2=light_path.IsReflectionRay, UseClamp=False)  # "use_reflect_refract_when_glossy_and_reflection"
refl_env_when_enabled = Multiply(Value1=m_shader_usecustomreflectionenvironmenta, Value2=use_reflect_refract_when_glossy_and_refl, UseClamp=False)

# ---- group: ENVMAP COMPONENT
environment_texture = Environment_texture(
    Vector=recombine_envmap_texco,
    ImTexColorSpace="None",
    ImTexInterpolation="Smart",
    ImTexProjection="Flat",
    ImTexTextureExtension="Repeat")  # -> Color, Alpha
attenuated_environment_color = Attenuated_environment_color(Color1=black, Color2=environment_texture.Color, Fac=m_shader_environmenttexture_amount, Blend="Blend")
environment_map_diffuse = Diffuse(Color=attenuated_environment_color, Roughness=0, Normal=Point(0, 0, 0))

# ---- group: REFLECTION COMPONENT
attenuated_reflection_color = Attenuated_reflection_color(Color1=black, Color2=m_shader_reflectioncolorgamma, Fac=m_shader_reflectivity, Blend="Blend")
glossy = Glossy(Color=attenuated_reflection_color, Roughness=m_shader_reflectionroughnesspow2, Normal=bump, Distribution="GGX")

# ---- group: DIFFUSE COMPONENT
# shadeless only from camera ray.
# 
# We shouldn't cast any light into the scene.
shadeless_bsdf = Shadeless_bsdf(Color=diffuse_base_color_through_alpha_2, Strength=1)
final_diffuse = Diffuse(Color=diffuse_base_color_through_alpha_2, Roughness=0, Normal=bump)
shadeless_on_cameraray = Multiply(Value1=light_path.IsCameraRay, Value2=m_shader_shadelessasfloat, UseClamp=False)
shadeless = Shadeless(Closure1=final_diffuse, Closure2=shadeless_bsdf, Fac=shadeless_on_cameraray)

# ---- group: REFRACTION COMPONENT
attennuated_refraction_color = Attennuated_refraction_color(Color1=black, Color2=m_shader_transparencycolorgamma, Fac=m_shader_transparency, Blend="Blend")
refraction = Refraction(
    Color=attennuated_refraction_color,
    Roughness=m_shader_refractionroughnesspow2,
    IOR=m_shader_ior,
    Normal=bump,
    Distribution="GGX")

# ---- group: shadow color
coloured_shadow_trans_color = Coloured_shadow_trans_color(Color=diffuse_base_color_through_alpha_2)

# ---- group: COMBINE ALL DIFFERENT PARTS
# Combine the diffuse and glossy components.
diffuse_plus_glossy = Diffuse_plus_glossy(Closure1=shadeless, Closure2=glossy, Fac=reflection_factor.R)

# Combine the diffuse+glossy with transparency
blend_in_transparency = Blend_in_transparency(Closure1=shadeless, Closure2=refraction, Fac=m_shader_transparency)
diffuse_glossy_and_refraction = Diffuse_glossy_and_refraction(Closure1=diffuse_plus_glossy, Closure2=blend_in_transparency, Fac=m_shader_transparency)

# ----
mix_diffuse_and_transparency_color = Mix(Color1=diffuse_base_color_through_alpha_2, Color2=attennuated_refraction_color, Fac=m_shader_transparency, Blend="Blend")
coloured_shadow_trans_color_for_principl = Coloured_shadow_trans_color(Color=mix_diffuse_and_transparency_color)  # "coloured_shadow_trans_color_for_principled"

# ---- group: COMBINE ALL DIFFERENT PARTS
# add the env mapping texture
custom_environment_blend = Custom_environment_blend(Closure1=diffuse_glossy_and_refraction, Closure2=environment_map_diffuse, Fac=m_shader_environmenttexture_amount)

# ---- group: PRINCIPLED EXTRA INPUTS
m_shader_metallic = Slider(0, range=0..1)
m_shader_specular = Slider(1, range=0..1)
m_shader_speculartint = Slider(1, range=0..1)
m_shader_sheen = Slider(1, range=0..1)
m_shader_clearcoat = Slider(1, range=0..1)
m_shader_clearcoatgloss = Slider(1, range=0..1)
m_shader_sheentint = Slider(1, range=0..1)

# ---- group: COMBINE ALL DIFFERENT PARTS
# Here we color the shadow
coloured_shadow_mix_custom = Coloured_shadow_mix_custom(Closure1=custom_environment_blend, Closure2=coloured_shadow_trans_color, Fac=weight_for_shadowray_coloured_shadow)

# ---- group: COMBINE ALL DIFFERENT PARTS / EMISSION COLOR COMPONENT
shadeless_emission = EmissionBSDF(Color=m_shader_emissioncolorgamma, Strength=1)
diffuse_from_emission_color = DiffuseBSDF(Color=m_shader_emissioncolorgamma, Roughness=0, Normal=Point(0, 0, 0))
diffuse_or_shadeless_emission = Blend(Closure1=diffuse_from_emission_color, Closure2=shadeless_emission, Fac=shadeless_on_cameraray)
add_emission_to_final = Add(Closure1=coloured_shadow_mix_custom, Closure2=diffuse_or_shadeless_emission)

# ---- group: THE FINAL OUTPUTS / GLASS FLOW
principledbsdf = Principledbsdf(
    BaseColor=mix_diffuse_and_transparency_color,
    Subsurface=0,
    SubsurfaceRadius=Point(0, 0, 0),
    SubsurfaceColor=RGB(128, 128, 128),
    Metallic=m_shader_metallic,
    Specular=m_shader_specular,
    SpecularTint=m_shader_speculartint,
    Roughness=m_shader_reflectionroughnesspow2,
    Anisotropic=0,
    AnisotropicRotation=0,
    Sheen=m_shader_sheen,
    SheenTint=m_shader_sheentint,
    Clearcoat=m_shader_clearcoat,
    ClearcoatGloss=m_shader_clearcoatgloss,
    IOR=m_shader_ior,
    Transmission=m_shader_transparency,
    TransmissionRoughness=m_shader_refractionroughnesspow2,
    Normal=bump,
    ClearcoatNormal=bump,
    Tangent=Point(0, 0, 0),
    Distribution="GGX")
custom_environment_blend_for_principled = Custom_environment_blend(Closure1=principledbsdf, Closure2=environment_map_diffuse, Fac=m_shader_environmenttexture_amount)
coloured_shadow_mix_glass_principled = Coloured_shadow_mix_glass_principled(
    Closure1=custom_environment_blend_for_principled,
    Closure2=coloured_shadow_trans_color_for_principl,
    Fac=weight_for_shadowray_coloured_shadow)

# ---- group: THE FINAL OUTPUTS
# Apply any transparency texture effects. This is where "cutouts" happen.
transparent = Transparent(Color=white)
custom_alpha_cutter = Custom_alpha_cutter(Closure1=add_emission_to_final, Closure2=transparent, Fac=add_diffuse_texture_alpha)

# ---- group: DEBUGGER
# Debugger. Use to view intermediate steps of shader.
diffuse_bsdf = DiffuseBSDF(Color=diffuse_base_color_through_alpha_2, Roughness=0, Normal=Point(0, 0, 0))
combine_rgb = CombineRGB(R=add_diffuse_texture_alpha, G=0, B=0)
output = Output(Surface=coloured_shadow_mix_glass_principled)

# ----
output_2 = Output(Surface=[custom_alpha_cutter, coloured_shadow_mix_glass_principled])
text_join = TextJoin(Text=output_2)
indentation = Slider(3, range=0..10)
ghpython_script = GhPythonScript(code=text_join, csharp_indent=indentation)  # -> out, csharp, xml; inputs csharp_indent: Int32
# ---------- ghpython_script: Python ----------
"""Provides a scripting component.
    Inputs:
        code: The input code as a string
    Output:
        out: Debug output
        csharp: C# code
        xml: XML code"""

__author__ = "Nathan"

import rhinoscriptsyntax as rs
import string
import re

lines = code.split("\n")

if not csharp_indent: csharp_indent = 0

lines_seen = list()

cleanedcsharp_nodes    = list()
cleanedcsharp_adds     = list()
cleanedcsharp_connects = list()

cleanedxml = list()

whitespace_start = re.compile("^(\s+)", re.S)
whitespace_var = re.compile("^(\s*var)", re.S)
var_start = re.compile("^(var).*", re.S)
novar_start = re.compile("^(?!var).*", re.S)
diffuse_texture_repeat = re.compile("^(\s*diffuse_texture)([0-9]+)(\.Extension.*)(Repeat);", re.S)

indentfix = re.compile(csharp_indent*"\t"+"\nvar", re.S)

for line in lines:
    strline = string.strip(line)
    if strline in lines_seen: continue
    lines_seen.append(strline)
    if line in cleanedcsharp_nodes or line in cleanedcsharp_adds or line in cleanedcsharp_connects or line in cleanedxml:
            continue
    if len(line) < 1: continue
    if line[0] == "-": continue
    if len(line)>1 and line[0] == "<" and line[1] == "!": continue
    if line[0] == "<":
        cleanedxml.append(line)
    else:
        if string.find(line, "(output.") > -1:
            continue
            
        if string.find(line, ".AddNode(") > -1:
            cleanedcsharp_adds.append(line)
        elif string.find(line, ".Connect(") > -1:
            cleanedcsharp_connects.append(line)
        else:
            cleanedcsharp_nodes.append(line)
            
            

intermcleanedcsharp_nodes = list()

for line in cleanedcsharp_nodes:
    nvs = re.search(novar_start, line)
    if nvs: line = "\t" + line
    line = re.sub(whitespace_start, "\t", line)
    line = re.sub(whitespace_var, "\nvar", line)
    
    line = re.sub(diffuse_texture_repeat, r'\1\2\3part.DiffuseTexture.Repeat ? TextureNode.TextureExtension.Repeat : TextureNode.TextureExtension.Clip;', line)

    if string.find(line, "var") == 0: line = "\n" + line
    
    intermcleanedcsharp_nodes.append(line)

cleanedcsharp = intermcleanedcsharp_nodes + ["\n"] + cleanedcsharp_adds + ["\n"] + cleanedcsharp_connects

joinstr = "\n" + csharp_indent * "\t"

intermcsharp = joinstr.join(cleanedcsharp[1:])
intermcsharp = string.replace(intermcsharp, "\r", "")
intermcsharp = string.replace(intermcsharp, "m_shader.", "part.")
intermcsharp = string.replace(intermcsharp, "new part", "part")
intermcsharp = string.replace(intermcsharp, "True;", "true;")
intermcsharp = string.replace(intermcsharp, "False;", "false;")
intermcsharp = string.replace(intermcsharp, "shader.AddNode", "m_shader.AddNode")
intermcsharp = string.replace(intermcsharp, " Repeat;", " TextureNode.TextureExtension.Repeat;")
intermcsharp = string.replace(intermcsharp, " Flat;", " TextureNode.TextureProjection.Flat;")
intermcsharp = string.replace(intermcsharp, " None;", " TextureNode.TextureColorSpace.None;")
intermcsharp = string.replace(intermcsharp, " Smart;", " InterpolationType.Smart;")
intermcsharp = string.replace(intermcsharp, "\n\n\n", "\n\n")
intermcsharp = string.strip(intermcsharp)

if csharp_indent > 0:
    intermcsharp = re.sub(indentfix, "\n" + csharp_indent*"\t" + "var" , intermcsharp)

csharp = csharp_indent*"\t" + intermcsharp

xml = "\n".join(cleanedxml)
# ---------- end ghpython_script ----------
panel = Panel(ghpython_script.csharp)

# ---- group: SKY LIGHTING
m_shader_skycoloras4float = ColourPicker(PickedColour=RGB(255, 255, 255))
m_shader_nonskyenvstrengthfactor = Slider(1, range=0..2)
m_shader_hasskyenvtextureasfloat = Slider(0, range=0..1)
m_shader_useskycolorasfloat = Slider(0, range=0..1)
m_shader_skylightenabledasfloat = Slider(0, range=0..1)
sky_env_texture = Environment(
    Vector=texcoord.Generated,
    ColorSpace="None",
    Environment="C:\Users\Nathan\Documents\RhinoStudio.png",
    Interpolation="Linear",
    Projection="Equirectangular")  # -> Color, Alpha

# ---- group: BG COLOR
m_shader_bgstrength = Slider(1, range=0..2)
skylight_strength_factor = Multiply(Value1=m_shader_bgstrength, Value2=m_shader_nonskyenvstrengthfactor, UseClamp=False)

# ---- group: SKY COLOR
m_shader_skystrength = Slider(1, range=0..1)
sky_or_not = Multiply(Value1=m_shader_skystrength, Value2=m_shader_skylightenabledasfloat, UseClamp=False)

# ---- group: REFL_REFR_COLOR
m_shader_reflstrength = Slider(1, range=0..1)
skylight_strength_factor_2 = Multiply(Value1=m_shader_reflstrength, Value2=m_shader_nonskyenvstrengthfactor, UseClamp=False)

separate_refl_color = SeparateRGB(Image=refl_color_or_texture)  # -> R, G, B

factor_refl_r = Multiply(Value1=separate_refl_color.R, Value2=skylight_strength_factor_2, UseClamp=False)
factor_refl_g = Multiply(Value1=separate_refl_color.G, Value2=skylight_strength_factor_2, UseClamp=False)
factor_refl_b = Multiply(Value1=separate_refl_color.B, Value2=skylight_strength_factor_2, UseClamp=False)

factored_refl_color = CombineRGB(R=factor_refl_r, G=factor_refl_g, B=factor_refl_b)

# ---- group: BG COLOR
separate_bg_color = SeparateRGB(Image=bg_color_or_texture)  # -> R, G, B

factor_r = Multiply(Value1=separate_bg_color.R, Value2=skylight_strength_factor, UseClamp=False)
factor_g = Multiply(Value1=separate_bg_color.G, Value2=skylight_strength_factor, UseClamp=False)
factor_b = Multiply(Value1=separate_bg_color.B, Value2=skylight_strength_factor, UseClamp=False)

factored_bg_color = CombineRGB(R=factor_r, G=factor_g, B=factor_b)

gradient_or_other = Mix(Color1=factored_bg_color, Color2=gradient_colorramp.Color, Fac=m_shader_usegradientasfloat, Blend="Blend")

# ---- group: SKY LIGHTING (continued)
skycolor_or_final_bg = Mix(Color1=gradient_or_other, Color2=m_shader_skycoloras4float, Fac=m_shader_useskycolorasfloat, Blend="Blend")
sky_color_or_texture = Mix(Color1=skycolor_or_final_bg, Color2=sky_env_texture.Color, Fac=m_shader_hasskyenvtextureasfloat, Blend="Blend")

# ---- group: SKY COLOR
separate_sky_color = SeparateRGB(Image=sky_color_or_texture)  # -> R, G, B

factor_sky_r = Multiply(Value1=separate_sky_color.R, Value2=sky_or_not, UseClamp=False)
factor_sky_g = Multiply(Value1=separate_sky_color.G, Value2=sky_or_not, UseClamp=False)
factor_sky_b = Multiply(Value1=separate_sky_color.B, Value2=sky_or_not, UseClamp=False)

factored_sky_color = CombineRGB(R=factor_sky_r, G=factor_sky_g, B=factor_sky_b)

# ----
number_slider = Slider(1, range=1..10)
camera_and_transmission = Add(Value1=light_path.IsCameraRay, Value2=light_path.IsTransmissionRay, UseClamp=False)
non_camera_rays = Subtract(Value1=1, Value2=light_path.IsCameraRay, UseClamp=False)
non_reflective_rays = Subtract(Value1=1, Value2=light_path.IsReflectionRay, UseClamp=False)
maximum = Maximum(Value1=light_path.IsCameraRay, Value2=light_path.IsGlossyRay, UseClamp=True)
refl_bg_or_custom_env = Mix(Color1=gradient_or_other, Color2=factored_refl_color, Fac=refl_env_when_enabled, Blend="Blend")
light_with_bg_or_sky = Mix(Color1=gradient_or_other, Color2=factored_sky_color, Fac=non_camera_rays, Blend="Blend")
invert_refl_switch = Subtract(Value1=1, Value2=refl_env_when_enabled, UseClamp=False)
invert_cam_and_transm = Subtract(Value1=1, Value2=camera_and_transmission, UseClamp=False)
divide = Divide(Value1=non_camera_rays, Value2=number_slider, UseClamp=False)
less_than = LessThan(Value1=divide, Value2=2, UseClamp=False)
combine_rgb_2 = CombineRGB(R=light_path.DiffuseDepth, G=0, B=number_slider)
non_diff_rays = Subtract(Value1=1, Value2=maximum, UseClamp=False)
maximum_2 = Maximum(Value1=maximum, Value2=light_path.IsTransmissionRay, UseClamp=True)
less_than_2 = LessThan(Value1=light_path.DiffuseDepth, Value2=1, UseClamp=False)
if_not_cam_nor_transm_nor_glossyrefl = Multiply(Value1=invert_refl_switch, Value2=invert_cam_and_transm, UseClamp=False)
mix = Mix(Color1=refl_bg_or_custom_env, Color2=light_with_bg_or_sky, Fac=if_not_cam_nor_transm_nor_glossyrefl, Blend="Blend")
maximum_3 = Maximum(Value1=maximum_2, Value2=light_path.IsSingularRay, UseClamp=True)
emission = EmissionBSDF(Color=combine_rgb_2, Strength=1)
diffuse = DiffuseBSDF(Color=combine_rgb_2, Roughness=0, Normal=Point(0, 0, 0))
final_bg = Background(Color=mix, Strength=1)
number_slider_2 = Slider(1, range=0..1)
bg_no_customs = Background(Color=gradient_or_other, Strength=maximum_3)

# ---- group: BACKGROUND
output_3 = Output(Surface=diffuse)
output_4 = Output(Surface=[bg_no_customs, final_bg])
indentation_2 = Slider(4, range=0..10)

# ----
text_join_2 = TextJoin(Text=output_4)

# ---- group: BACKGROUND (continued)
ghpython_script_2 = GhPythonScript(code=text_join_2, csharp_indent=indentation_2)  # -> out, csharp, xml; inputs csharp_indent: Int32
# ---------- ghpython_script_2: Python ----------
"""Provides a scripting component.
    Inputs:
        code: The input code as a string
    Output:
        out: Debug output
        csharp: C# code
        xml: XML code"""

__author__ = "Nathan"

import rhinoscriptsyntax as rs
import string
import re

lines = code.split("\n")

if not csharp_indent: csharp_indent = 0

lines_seen = list()

cleanedcsharp_nodes    = list()
cleanedcsharp_adds     = list()
cleanedcsharp_connects = list()

cleanedxml = list()

whitespace_start = re.compile("^(\s+)", re.S)
whitespace_var = re.compile("^(\s*var)", re.S)
var_start = re.compile("^(var).*", re.S)
novar_start = re.compile("^(?!var).*", re.S)
diffuse_texture_repeat = re.compile("^(\s*diffuse_texture)([0-9]+)(\.Extension.*)(Repeat);", re.S)

indentfix = re.compile(csharp_indent*"\t"+"\nvar", re.S)

for line in lines:
    strline = string.strip(line)
    if strline in lines_seen: continue
    lines_seen.append(strline)
    if line in cleanedcsharp_nodes or line in cleanedcsharp_adds or line in cleanedcsharp_connects or line in cleanedxml:
            continue
    if len(line) < 1: continue
    if line[0] == "-": continue
    if len(line)>1 and line[0] == "<" and line[1] == "!": continue
    if line[0] == "<":
        cleanedxml.append(line)
    else:
        if string.find(line, "(output.") > -1:
            continue
            
        if string.find(line, ".AddNode(") > -1:
            cleanedcsharp_adds.append(line)
        elif string.find(line, ".Connect(") > -1:
            cleanedcsharp_connects.append(line)
        else:
            cleanedcsharp_nodes.append(line)
            
            

intermcleanedcsharp_nodes = list()

for line in cleanedcsharp_nodes:
    nvs = re.search(novar_start, line)
    if nvs: line = "\t" + line
    line = re.sub(whitespace_start, "\t", line)
    line = re.sub(whitespace_var, "\nvar", line)
    
    line = re.sub(diffuse_texture_repeat, r'\1\2\3part.DiffuseTexture.Repeat ? TextureNode.TextureExtension.Repeat : TextureNode.TextureExtension.Clip;', line)

    if string.find(line, "var") == 0: line = "\n" + line
    
    intermcleanedcsharp_nodes.append(line)

cleanedcsharp = intermcleanedcsharp_nodes + ["\n"] + cleanedcsharp_adds + ["\n"] + cleanedcsharp_connects

joinstr = "\n" + csharp_indent * "\t"

intermcsharp = joinstr.join(cleanedcsharp[1:])
intermcsharp = string.replace(intermcsharp, "\r", "")
intermcsharp = string.replace(intermcsharp, "m_shader.", "m_original_background.")
intermcsharp = string.replace(intermcsharp, "new m_original", "m_original")
intermcsharp = string.replace(intermcsharp, "True;", "true;")
intermcsharp = string.replace(intermcsharp, "False;", "false;")
intermcsharp = string.replace(intermcsharp, "shader.AddNode", "m_shader.AddNode")
intermcsharp = string.replace(intermcsharp, " Repeat;", " TextureNode.TextureExtension.Repeat;")
intermcsharp = string.replace(intermcsharp, " Flat;", " TextureNode.TextureProjection.Flat;")
intermcsharp = string.replace(intermcsharp, " Equirectangular;", " TextureNode.EnvironmentProjection.Equirectangular;")
intermcsharp = string.replace(intermcsharp, " None;", " TextureNode.TextureColorSpace.None;")
intermcsharp = string.replace(intermcsharp, " Smart;", " InterpolationType.Smart;")
intermcsharp = string.replace(intermcsharp, " Linear;", " InterpolationType.Linear;")
intermcsharp = string.replace(intermcsharp, "ccl.ShaderNodes.", "")
intermcsharp = string.replace(intermcsharp, "\n\n\n", "\n\n")
intermcsharp = string.strip(intermcsharp)

if csharp_indent > 0:
    intermcsharp = re.sub(indentfix, "\n" + csharp_indent*"\t" + "var" , intermcsharp)

csharp = csharp_indent*"\t" + intermcsharp

xml = "\n".join(cleanedxml)
# ---------- end ghpython_script_2 ----------
panel_2 = Panel(ghpython_script_2.csharp)
panel_3 = Panel(ghpython_script_2.xml)
